# Grasshopper definition Mallard2Test.ghx (Grasshopper 1.0.7)
# plug-ins: GrasshopperAsyncComponentDemo, jSwan

serialize_json = SerializeJson(D1="big", D2="tall", IncludeNullAndEmptyProperties=False)
serialize_json_2 = SerializeJson(D1="big", D2="tall", IncludeNullAndEmptyProperties=False)
list_airtable_records = ListAirtableRecords(BaseID="appsj7ZSiHOfUvzXk", AppKey="keyjxzgBUonIj836P", TableName="Table 2", ViewName="Grid view")  # -> ErrorMessage, OutRecords
format = Format(Culture=127)
merge = Merge(
    Data1="Name",
    Data2="Notes",
    Data3="Attachments",
    Data4="Status",
    Data5="multi",
    Data6="check",
    Data7="Collaborators",
    Data8="Date",
    Data9="barcode",
    Data10="Rating",
    Data11="URL",
    Data12="Departments",
    Data13="Notes (from Departments)")
airtable_record_fields = AirtableRecordFields(Records=list_airtable_records.OutRecords, FieldName=graft(merge))
list_item = ListItem(List=list_airtable_records.OutRecords, Index=Slider(8, range=0..10), Wrap=True)
deserialize_json = DeserializeJson(JSON=airtable_record_fields, OutputsLocked=False)
tree_branch = TreeBranch(Tree=simplify(airtable_record_fields), Path=Slider(4, range=0..10), MaintainPaths=True)
time = Time(airtable_record_fields)
panel = Panel("""is cool
null""")
panel_2 = Panel("""Jonah
Joao""")
panel_3 = Panel("""big, tall, athletic
short, small""")
airtable_record_fields_2 = AirtableRecordFields(Records=deserialize_json, FieldName=graft("Company"))
panel_4 = Panel(airtable_record_fields)
shortest_list = ShortestList(ListListA=panel_2, ListListB=panel_3, TrimMode=2)  # -> ListListA, ListListB
merge_2 = Merge(Data1="Name", Data2="multi")
entwine = Entwine(Branch00=shortest_list.ListListA, Branch01=shortest_list.ListListB, FlattenInputs=True)
create_new_airtable_records = CreateNewAirtableRecords(BaseID="appsj7ZSiHOfUvzXk", AppKey="keyjxzgBUonIj836P", TableName="Table 2", FieldNames=merge_2, Fields=entwine)  # -> ErrorMessage, OutRecords
delete_airtable_record = DeleteAirtableRecord(Refresh=Toggle(False), BaseID="appsj7ZSiHOfUvzXk", AppKey="keyjxzgBUonIj836P", TableName="Table 2", RecordID=list_item)  # -> ErrorMessage, OutRecord
panel_5 = Panel(create_new_airtable_records.ErrorMessage)
panel_6 = Panel(create_new_airtable_records.OutRecords)
airtable_record_fields_3 = AirtableRecordFields(Records=create_new_airtable_records.OutRecords, FieldName="Name")
